# Dynamo graph Architect_Plus_Spaceplanning_Complete_1.dyn (Dynamo 3.5.0.8297)

json_file_path = StringInput("output/enhanced_design.json")  # graph input
design_seed = IntegerSlider(50, range=1..100 step 1)  # graph input
circulation_factor = DoubleSlider(1.8, range=1..3 step 0.1)  # graph input
acceptable_width = DoubleSlider(18, range=5..30 step 0.5)  # graph input
architect_plus_spaceplanning = Python(IN[0]=json_file_path, IN[1]=design_seed, IN[2]=circulation_factor, IN[3]=acceptable_width)  # CPython3
# ---------- architect_plus_spaceplanning.python (14 lines) ----------
# Basic imports
import json

# Get inputs
json_path = IN[0] if IN[0] else "output/enhanced_design.json"
design_seed = IN[1] if len(IN) > 1 else 50
circulation_factor = IN[2] if len(IN) > 2 else 1.8
acceptable_width = IN[3] if len(IN) > 3 else 18.0

# Create separate outputs
OUT = []
OUT.append(["Department 1", "Department 2"])  # Output 0: Department Polygons
OUT.append(["Program 1", "Program 2"])        # Output 1: Program Polygons
OUT.append(["Circulation 1", "Circulation 2"]) # Output 2: Circulation Network
# ----------------------------------------
department_polygons = Watch(architect_plus_spaceplanning)  # graph output
program_polygons = Watch(architect_plus_spaceplanning)  # graph output
circulation_network = Watch()  # graph output; unwired: arg0
n3d_building_geometry = Watch()  # "3D Building Geometry"; graph output; unwired: arg0
programs = Modifiers.GeometryColor.ByGeometryColor()  # unwired: geometry, color
circulation = Modifiers.GeometryColor.ByGeometryColor()  # unwired: geometry, color
departments = Modifiers.GeometryColor.ByGeometryColor()  # unwired: geometry, color
