# Dynamo graph Architect_plus.dyn "Architect_Plus_Spaceplanning_Complete" (Dynamo 3.5.0.8297)

department_polygons = Watch()  # graph output; unwired: arg0
program_polygons = Watch()  # graph output; unwired: arg0
circulation_paths = Watch()  # graph output; unwired: arg0
translate = Geometry.Translate()  # unwired: geometry, xTranslation, yTranslation, zTranslation
json_file_path = StringInput("output/enhanced_design.json")  # graph input
design_seed = IntegerSlider(50, range=1..100 step 1)  # graph input
circulation_factor = DoubleSlider(1.8, range=1..3 step 0.1)  # graph input
acceptable_width = DoubleSlider(18, range=5..30 step 0.5)  # graph input
architect_plus_spaceplanning = Python(IN[0]=json_file_path, IN[1]=design_seed, IN[2]=circulation_factor, IN[3]=acceptable_width)  # CPython3
# ---------- architect_plus_spaceplanning.python (165 lines) ----------
# Add imports
import sys
import os
import json
import traceback
import math
import random

# Load required libraries
import clr
clr.AddReference('ProtoGeometry')
clr.AddReference('DSCoreNodes')

# Import geometry classes
from Autodesk.DesignScript.Geometry import Point, Line, Surface, Polygon, Vector, Solid, CoordinateSystem
from DSCore import Color

# Get inputs
json_path = IN[0] if IN[0] else "output/enhanced_design.json"
design_seed = IN[1] if len(IN) > 1 else 50
circulation_factor = IN[2] if len(IN) > 2 else 1.8
acceptable_width = IN[3] if len(IN) > 3 else 18.0

# Set random seed for consistent colors
random.seed(design_seed)

def create_color(r, g, b, a=255):
    return Color.ByARGB(a, r, g, b)

def generate_random_color(alpha=255):
    return Color.ByARGB(alpha, random.randint(0, 255), random.randint(0, 255), random.randint(0, 255))

def create_extruded_polygon(points, height, color):
    # Create base polygon
    base_points = [Point.ByCoordinates(x, y, 0) for x, y in points]
    base_polygon = Polygon.ByPoints(base_points)
    
    # Create solid by extrusion
    vector = Vector.ByCoordinates(0, 0, height)
    solid = base_polygon.Extrude(vector)
    
    return solid, color

try:
    # Read the JSON file
    with open(json_path, 'r') as f:
        design_data = json.load(f)
    
    # Initialize result lists
    department_geometry = []
    program_geometry = []
    circulation_geometry = []
    walls = []
    structural_elements = []
    
    # Process raw spaceplanning data
    if 'raw_spaceplanning' in design_data:
        raw_data = design_data['raw_spaceplanning']
        
        # Process departments and their polygons
        for dept in raw_data.get('departments', []):
            dept_color = generate_random_color(200)
            
            # Create department geometry
            if 'DepartmentPolygon' in dept and 'points' in dept['DepartmentPolygon']:
                points = dept['DepartmentPolygon']['points']
                height = max([prog.get('Height', 3.0) for prog in dept.get('ProgramsInDept', [])] or [3.0])
                solid, color = create_extruded_polygon(points, height, dept_color)
                department_geometry.append((solid, color, dept.get('DeptName', 'Unknown')))
            
            # Process programs within department
            for prog in dept.get('ProgramsInDept', []):
                if 'ProgramPolygon' in prog and 'points' in prog['ProgramPolygon']:
                    points = prog['ProgramPolygon']['points']
                    height = prog.get('Height', 3.0)
                    # Create slightly lighter color for programs
                    prog_color = Color.ByARGB(180, 
                                             min(dept_color.Red + 30, 255),
                                             min(dept_color.Green + 30, 255),
                                             min(dept_color.Blue + 30, 255))
                    solid, color = create_extruded_polygon(points, height, prog_color)
                    program_geometry.append((solid, color, prog.get('ProgramName', 'Unknown')))
        
        # Process circulation paths
        if 'circulation' in raw_data and 'paths' in raw_data['circulation']:
            circ_color = create_color(150, 150, 150, 180)
            for path in raw_data['circulation']['paths']:
                start = path['start']
                end = path['end']
                width = path.get('width', 2.0)
                
                # Create path centerline
                start_pt = Point.ByCoordinates(start[0], start[1], 0)
                end_pt = Point.ByCoordinates(end[0], end[1], 0)
                centerline = Line.ByStartPointEndPoint(start_pt, end_pt)
                
                # Create circulation corridor
                direction = Vector.ByTwoPoints(start_pt, end_pt).Normalize()
                perpendicular = direction.Cross(Vector.ByCoordinates(0, 0, 1)).Normalize()
                
                # Create corridor polygon points
                p1 = start_pt.Add(perpendicular.Scale(width/2))
                p2 = end_pt.Add(perpendicular.Scale(width/2))
                p3 = end_pt.Add(perpendicular.Scale(-width/2))
                p4 = start_pt.Add(perpendicular.Scale(-width/2))
                
                corridor_polygon = Polygon.ByPoints([p1, p2, p3, p4])
                corridor_solid = corridor_polygon.Extrude(Vector.ByCoordinates(0, 0, 3.0))
                circulation_geometry.append((corridor_solid, circ_color, 'Circulation'))
    
    # Process building elements from design data
    if 'design' in design_data:
        design = design_data['design']
        
        # Process walls
        wall_color = create_color(200, 200, 200)
        for wall in design.get('walls', []):
            start = wall['start']
            end = wall['end']
            height = wall.get('height', 3.0)
            thickness = wall.get('thickness', 0.2)
            
            start_pt = Point.ByCoordinates(start['x'], start['y'], start['z'])
            end_pt = Point.ByCoordinates(end['x'], end['y'], end['z'])
            
            # Create wall geometry similar to circulation corridors
            direction = Vector.ByTwoPoints(start_pt, end_pt).Normalize()
            perpendicular = direction.Cross(Vector.ByCoordinates(0, 0, 1)).Normalize()
            
            p1 = start_pt.Add(perpendicular.Scale(thickness/2))
            p2 = end_pt.Add(perpendicular.Scale(thickness/2))
            p3 = end_pt.Add(perpendicular.Scale(-thickness/2))
            p4 = start_pt.Add(perpendicular.Scale(-thickness/2))
            
            wall_polygon = Polygon.ByPoints([p1, p2, p3, p4])
            wall_solid = wall_polygon.Extrude(Vector.ByCoordinates(0, 0, height))
            walls.append((wall_solid, wall_color, 'Wall'))
        
        # Process structural elements
        struct_color = create_color(100, 100, 100)
        for struct in design.get('structural', []):
            if struct['type'] == 'column':
                pos = struct['position']
                diameter = struct.get('diameter', 0.4)
                height = struct.get('height', 3.0)
                
                # Create column as cylinder
                base_pt = Point.ByCoordinates(pos['x'], pos['y'], pos['z'])
                cs = CoordinateSystem.ByOrigin(base_pt)
                circle = Circle.ByCenterPointRadius(cs, diameter/2)
                column = circle.Extrude(Vector.ByCoordinates(0, 0, height))
                structural_elements.append((column, struct_color, 'Column'))
    
    # Return all geometry with their colors and labels
    OUT = [
        department_geometry,   # (solid, color, name) tuples for departments
        program_geometry,      # (solid, color, name) tuples for programs
        circulation_geometry,  # (solid, color, name) tuples for circulation
        walls,                # (solid, color, name) tuples for walls
        structural_elements   # (solid, color, name) tuples for structural elements
    ]
    
except Exception as e:
    # Return error message if something goes wrong
    OUT = [str(e), traceback.format_exc()]
# ----------------------------------------
integerSlider = IntegerSlider(0, range=0..2 step 1)
getItemAtIndex = List.GetItemAtIndex(list=architect_plus_spaceplanning, index=integerSlider)
department_color = Color.ByARGB()  # unwired: a, r, g, b
byGeometryColor = Display.ByGeometryColor(geometry=getItemAtIndex, color=department_color)
integerSlider_2 = IntegerSlider(1, range=0..2 step 1)
getItemAtIndex_2 = List.GetItemAtIndex(list=architect_plus_spaceplanning, index=integerSlider_2)
program_color = Color.ByARGB()  # unwired: a, r, g, b
byGeometryColor_2 = Display.ByGeometryColor(geometry=getItemAtIndex_2, color=program_color)
integerSlider_3 = IntegerSlider(2, range=0..2 step 1)
getItemAtIndex_3 = List.GetItemAtIndex(list=architect_plus_spaceplanning, index=integerSlider_3)
circulation_color = Color.ByARGB()  # unwired: a, r, g, b
byGeometryColor_3 = Display.ByGeometryColor(geometry=getItemAtIndex_3, color=circulation_color)
getItemAtIndex_4 = List.GetItemAtIndex()  # unwired: list, index
wall_color = Color.ByARGB()  # unwired: a, r, g, b
byGeometryColor_4 = Display.ByGeometryColor(geometry=getItemAtIndex_4, color=wall_color)
getItemAtIndex_5 = List.GetItemAtIndex()  # unwired: list, index
structural_color = Color.ByARGB()  # unwired: a, r, g, b
byGeometryColor_5 = Display.ByGeometryColor(geometry=getItemAtIndex_5, color=structural_color)
doubleSlider = DoubleSlider(0, range=-50..50 step 1)
doubleSlider_2 = DoubleSlider(0, range=-50..50 step 1)
doubleSlider_3 = DoubleSlider(0, range=-50..50 step 1)
walls = Watch()  # graph output; unwired: arg0
structural_elements = Watch()  # graph output; unwired: arg0
integerSlider_4 = IntegerSlider(3, range=0..4 step 1)
integerSlider_5 = IntegerSlider(4, range=0..4 step 1)
