# Dynamo graph Architect_Plus_Spaceplanning_Complete.dyn (Dynamo 2.19.0.5742)

# group: Architect Plus Spaceplanning Integration
# Complete integration of Gemini AI JSON with Spaceplanning zero-touch nodes.
# Processes architectural designs from text prompts and generates 3D geometry.
json_file_path = StringInput("output/design.json")  # graph input
design_seed = DoubleSlider(50, range=1..100 step 1)  # graph input
circulation_factor = DoubleSlider(1.8, range=1..3 step 0.1)  # graph input
architect_plus_spaceplanning = Python(IN[0]=json_file_path, IN[1]=design_seed, IN[2]=circulation_factor)  # CPython3; unwired: IN[3]
# ---------- architect_plus_spaceplanning.python (213 lines) ----------
# Architect Plus Spaceplanning Integration
# Processes Gemini JSON and generates architectural geometry

import sys
import os
import json
import clr
import traceback

# Add references for Dynamo geometry
try:
    clr.AddReference('ProtoGeometry')
    from Autodesk.DesignScript.Geometry import *
    GEOMETRY_AVAILABLE = True
except:
    GEOMETRY_AVAILABLE = False
    print("ProtoGeometry not available, using mock objects")

# Add current directory to path
sys.path.append(os.path.dirname(os.path.abspath(__file__)))

# Import our integration module
try:
    from dynamo_spaceplanning_integration import DynamoSpaceplanningIntegrator
    INTEGRATION_AVAILABLE = True
except Exception as e:
    INTEGRATION_AVAILABLE = False
    print(f"Integration module not available: {e}")

def safe_process_spaceplanning(json_path, design_seed, circulation_factor, acceptable_width):
    """Safely process spaceplanning with error handling"""
    try:
        if not INTEGRATION_AVAILABLE:
            return create_fallback_geometry()
        
        # Initialize integrator
        integrator = DynamoSpaceplanningIntegrator(json_path)
        
        # Override parameters
        integrator.design_params['circulation_factor'] = circulation_factor
        
        # Run spaceplanning
        results = integrator.run_complete_spaceplanning(int(design_seed))
        
        if results.get('success'):
            return extract_geometry_from_results(results)
        else:
            print(f"Spaceplanning failed: {results.get('message', 'Unknown error')}")
            return create_fallback_geometry()
            
    except Exception as e:
        print(f"Error in spaceplanning: {e}")
        print(traceback.format_exc())
        return create_fallback_geometry()

def create_fallback_geometry():
    """Create fallback geometry when spaceplanning fails"""
    try:
        if GEOMETRY_AVAILABLE:
            # Create simple rectangular building
            site_points = [
                Point.ByCoordinates(0, 0, 0),
                Point.ByCoordinates(100, 0, 0),
                Point.ByCoordinates(100, 150, 0),
                Point.ByCoordinates(0, 150, 0)
            ]
            
            # Create departments
            dept1_points = [
                Point.ByCoordinates(10, 10, 0),
                Point.ByCoordinates(40, 10, 0),
                Point.ByCoordinates(40, 40, 0),
                Point.ByCoordinates(10, 40, 0)
            ]
            
            dept2_points = [
                Point.ByCoordinates(50, 10, 0),
                Point.ByCoordinates(90, 10, 0),
                Point.ByCoordinates(90, 40, 0),
                Point.ByCoordinates(50, 40, 0)
            ]
            
            # Create polygons
            site_polygon = Polygon.ByPoints(site_points)
            dept1_polygon = Polygon.ByPoints(dept1_points)
            dept2_polygon = Polygon.ByPoints(dept2_points)
            
            # Create 3D surfaces
            site_surface = Surface.ByPatch(site_polygon)
            dept1_surface = dept1_polygon.Extrude(Vector.ByCoordinates(0, 0, 3.5))
            dept2_surface = dept2_polygon.Extrude(Vector.ByCoordinates(0, 0, 3.5))
            
            # Create circulation line
            circulation_line = Line.ByStartPointEndPoint(
                Point.ByCoordinates(25, 25, 0),
                Point.ByCoordinates(70, 25, 0)
            )
            
            return {
                'departments': [dept1_polygon, dept2_polygon],
                'programs': [dept1_polygon, dept2_polygon],  # Simplified
                'circulation': [circulation_line],
                'geometry_3d': [dept1_surface, dept2_surface],
                'site_outline': site_polygon,
                'building_data': {
                    'departments': ['Emergency Department', 'Patient Care'],
                    'total_area': 1800,
                    'floors': 3
                },
                'status': 'Fallback geometry created successfully'
            }
        else:
            # Return mock data when geometry is not available
            return {
                'departments': ['Mock Department 1', 'Mock Department 2'],
                'programs': ['Mock Program 1', 'Mock Program 2'],
                'circulation': ['Mock Circulation'],
                'geometry_3d': ['Mock 3D Geometry'],
                'site_outline': 'Mock Site Outline',
                'building_data': {
                    'departments': ['Emergency Department', 'Patient Care'],
                    'total_area': 1800,
                    'floors': 3
                },
                'status': 'Mock geometry created (ProtoGeometry not available)'
            }
            
    except Exception as e:
        print(f"Error creating fallback geometry: {e}")
        return {
            'departments': [],
            'programs': [],
            'circulation': [],
            'geometry_3d': [],
            'site_outline': None,
            'building_data': {},
            'status': f'Error: {str(e)}'
        }

def extract_geometry_from_results(results):
    """Extract geometry from spaceplanning results"""
    try:
        departments = results.get('departments', [])
        circulation = results.get('circulation', [])
        geometry_3d = results.get('geometry_3d', [])
        site_outline = results.get('site_outline')
        building_outline = results.get('building_outline')
        
        # Extract department polygons
        dept_polygons = []
        program_polygons = []
        
        for dept in departments:
            dept_poly = dept.get('DeptPolygon')
            if dept_poly:
                dept_polygons.append(dept_poly)
            
            # Extract program polygons
            for program in dept.get('ProgramsInDept', []):
                prog_poly = program.get('ProgramPolygon')
                if prog_poly:
                    program_polygons.append(prog_poly)
        
        # Prepare building data
        building_data = {
            'departments': [dept.get('DeptName', 'Unknown') for dept in departments],
            'total_area': sum(dept.get('DeptAreaProvided', 0) for dept in departments),
            'floors': results.get('design_parameters', {}).get('building_info', {}).get('floors', 1)
        }
        
        return {
            'departments': dept_polygons,
            'programs': program_polygons,
            'circulation': circulation,
            'geometry_3d': geometry_3d,
            'site_outline': site_outline,
            'building_data': building_data,
            'status': 'Spaceplanning completed successfully'
        }
        
    except Exception as e:
        print(f"Error extracting geometry: {e}")
        return create_fallback_geometry()

# Main execution
try:
    # Get inputs
    json_path = IN[0] if IN[0] else "output/design.json"
    design_seed = IN[1] if len(IN) > 1 else 50
    circulation_factor = IN[2] if len(IN) > 2 else 1.8
    acceptable_width = IN[3] if len(IN) > 3 else 18.0
    
    # Process spaceplanning
    results = safe_process_spaceplanning(json_path, design_seed, circulation_factor, acceptable_width)
    
    # Set outputs
    OUT = [
        results.get('departments', []),
        results.get('programs', []),
        results.get('circulation', []),
        results.get('geometry_3d', []),
        results.get('site_outline'),
        results.get('building_data', {}),
        results.get('status', 'Processing completed')
    ]
    
except Exception as e:
    error_msg = f"Critical error: {str(e)}"
    print(error_msg)
    print(traceback.format_exc())
    
    # Return error state
    OUT = [[], [], [], [], None, {}, error_msg]
# ----------------------------------------

# group: Outputs
# Generated architectural geometry and building data ready for Revit Design Automation.
department_polygons = Watch(architect_plus_spaceplanning.OUT_0)  # graph output
program_polygons = Watch(architect_plus_spaceplanning.OUT_1)  # graph output
n3d_building_geometry = Watch(architect_plus_spaceplanning.OUT_3)  # "3D Building Geometry"; graph output
building_data = Watch(architect_plus_spaceplanning.OUT_5)  # graph output
processing_status = Watch(architect_plus_spaceplanning.OUT_6)  # graph output
